# Dynamo graph AnnotationCreator.dyn (Dynamo 2.0.2.6826)

# group: Select detail lines
select_model_elements = DSModelElementsSelection()  # 38 picked in the model

geometry = Element.Geometry(element=select_model_elements)
flatten = List.Flatten(list=geometry)
python_script = Python(IN[0]=flatten)
# ---------- python_script.python (61 lines) ----------
import clr

clr.AddReference('RevitAPI')
from Autodesk.Revit.DB import *
from Autodesk.Revit.DB.Structure import *

clr.AddReference('RevitNodes')
import Revit
clr.ImportExtensions(Revit.GeometryConversion)
clr.ImportExtensions(Revit.Elements)

clr.AddReference('RevitServices')
import RevitServices
from RevitServices.Persistence import DocumentManager
from RevitServices.Transactions import TransactionManager

doc = DocumentManager.Instance.CurrentDBDocument
uidoc=DocumentManager.Instance.CurrentUIApplication.ActiveUIDocument

#Unwrapping Dynamoelement to Revit element.
lineList = UnwrapElement(IN[0])

geoList = []
interList = []
flatList =[]
uniqListStr = []
stringList =[]
uniqListOUT =[]
#Do some action in a Transaction

x = lineList[0].DoesIntersect(lineList[1])

for l1 in lineList:
	for l2 in lineList:
		if l1 == l2:
			pass
		else:
			if l1.DoesIntersect(l2):
				interList.append(l1.Intersect(l2))
			else:
				pass
				
for x in interList:
	stringList.append(x[0].ToString())
	flatList.append(x[0])

for x in stringList:
	if x not in uniqListStr:
		uniqListStr.append(x)
		uniqListOUT.append(flatList[(stringList.index(x))])
	

	


TransactionManager.Instance.EnsureInTransaction(doc)


TransactionManager.Instance.TransactionTaskDone()

OUT =  uniqListOUT
# ----------------------------------------
deconstruct = WombatDynamo.Point.Deconstruct(point=python_script)
code_block = CodeBlock { 5700; }
byCoordinates = Point.ByCoordinates(x=deconstruct.X, y=deconstruct.Y, z=code_block)

# group: Select the view where you want to create anotations and reference level
views = Views(index=80)
levels = Levels(index=3)

asVector = Point.AsVector(point=byCoordinates)
deconstruct_2 = WombatDynamo.Point.Deconstruct(point=python_script)
code_block_2 = CodeBlock { 0; }
byCoordinates_2 = Point.ByCoordinates(x=deconstruct_2.X, y=deconstruct_2.Y, z=code_block_2)
asVector_2 = Point.AsVector(point=byCoordinates_2)
boolean = BoolSelector(false)

# group: CLOCKWORK ORANGE LIBRARY
byFloorPlanAndPoint = Custom[SpotElevation.ByFloorPlanAndPoint](point=byCoordinates, floorPlan=views, bend=asVector, end=asVector_2, hasLeader=boolean)  # Places a spot elevation at a given point in a given floor plan.

elevation = Level.Elevation(level=levels)
