# Dynamo graph IsolateMIP.dyn (Dynamo 2.0.2.6826)

all_elements_in_active_view = ElementsInView()
watch = Watch(all_elements_in_active_view)
isInPlace = WombatDynamo.FamilyInstance.IsInPlace(instance=watch)
boolean = BoolSelector(false)
replaceNulls = Lists.Manage.ReplaceNulls(Data=isInPlace, ReplaceWith=boolean)
filterByBoolMask = List.FilterByBoolMask(list=watch, mask=replaceNulls)
watch_2 = Watch(filterByBoolMask.out)
watch_3 = Watch(filterByBoolMask.in)
views = Views(index=2)
isolate_in_view = Custom[Isolate in View](Element=watch_3, View=views)  # This node will take input of elements and a view to isolate selected elements in a view.
