# Dynamo graph MIPtoFam.dyn (Dynamo 2.10.1.3976)
# packages: spring nodes 203.1.0

select_model_element = DSModelElementSelection()  # 1 picked in the model; frozen
python_script = Python(IN[0]=select_model_element)  # IronPython2
# ---------- python_script.python (64 lines) ----------
# Enable Python support and load DesignScript library
import clr
clr.AddReference('ProtoGeometry')
from Autodesk.DesignScript.Geometry import *

#import Revit API
clr.AddReference('RevitAPI')
from Autodesk.Revit.DB import *

#import Manager Classes(this is for transactions)

clr.AddReference('RevitServices')
from RevitServices.Persistence import DocumentManager
from RevitServices.Transactions import TransactionManager

clr.AddReference('RevitNodes')
import Revit
clr.ImportExtensions(Revit.Elements)
clr.ImportExtensions(Revit.GeometryConversion)




dataEnteringNode = UnwrapElement(IN[0])
x = dataEnteringNode.GetType()
y = dataEnteringNode.GetOriginalGeometry(Options())

nlist = []

for el in y:
		nlist.append(el.Faces)



OUT = x,  nlist

"""
# The inputs to this node will be stored as a list in the IN variables.
familytype = UnwrapElement(IN[0])
output =[]

# Place your code below this line
doc = DocumentManager.Instance.CurrentDBDocument

TransactionManager.Instance.EnsureInTransaction(doc)

for x in range(0, 5000, 500):
	x =UnitUtils.ConvertToInternalUnits(x, DisplayUnitType.DUT_MILLIMETERS)
	fam = doc.Create.NewFamilyInstance(XYZ(x, 0, 0), familytype, Structure.StructuralType.NonStructural)
	wrappedfam = fam.ToDSType(True) #wraps element so it's visible in Dynamo
	output.append(wrappedfam)
	
#End transaction

TransactionManager.Instance.TransactionTaskDone()
	

# Assign your output to the OUT variable.
OUT = output



"""
# Enable Python support and load DesignScript library
# ----------------------------------------
watch = Watch(python_script)
select_model_element_2 = DSModelElementSelection()  # 1 picked in the model
geometry = Element.Geometry(element=select_model_element_2)
lastItem = List.LastItem(list=geometry)
file_path = Filename("C:\ProgramData\Autodesk\RVT 2022\Family Templates\English\Metric Generic Model.rft")
code_block = CodeBlock { "POINT2_StairStinger_01"; }
categories = Categories("OST_GenericModel")
string = StringInput("POINT2_MATERIAL_GREY")
byName = Material.ByName(name=string)
string_2 = StringInput("")
ꟿ_familyinstance_bygeometry = Custom[ꟿ FamilyInstance.ByGeometry](geometry=lastItem, familyTemplatePath=file_path, familyName=code_block, category=categories, materialName=byName, subcategoryName=string_2)  # package spring nodes
watch_2 = Watch(ꟿ_familyinstance_bygeometry.family)
watch_3 = Watch(ꟿ_familyinstance_bygeometry.instance)
boolean = BoolSelector(true)
bakeElements = Revit.Utilities.BakeElements(element=watch_3, bakeElementsToggle=boolean)  # frozen
watch_4 = Watch(bakeElements.element)
watch_5 = Watch(bakeElements.wasRan)
byUnion = Solid.ByUnion()  # unwired: solids
