# Dynamo graph RenameElements.dyn (Dynamo 2.0.2.6826)

element_types = ElementTypes(index=301)
all_elements_of_type = ElementsOfType(element_type=element_types)
name = Family.Name(family=all_elements_of_type)
string_from_object = FromObject(obj=name)
code_block = CodeBlock { "POINT2"; }
boolean = BoolSelector(true)
contains = String.Contains(str=string_from_object, searchFor=code_block, ignoreCase=boolean)
filterByBoolMask = List.FilterByBoolMask(list=all_elements_of_type, mask=contains)
name_2 = Element.Name(element=filterByBoolMask.in)
code_block_2 = CodeBlock { "POINT2"; }
code_block_3 = CodeBlock { "KRBIM"; }
replace = String.Replace(str=name_2, searchFor=code_block_2, replaceWith=code_block_3)
setName = Custom[Element.SetName](element=filterByBoolMask.in, name=replace)  # Gets the name of a given Revit element
watch = Watch(setName.Success)
watch_2 = Watch(setName.Fail)
code_block_4 = CodeBlock { 5; }
getItemAtIndex = List.GetItemAtIndex(list=all_elements_of_type, index=code_block_4)
getParameterValueByName = Element.GetParameterValueByName(element=getItemAtIndex)  # unwired: parameterName
string = StringInput("URL")
string_2 = StringInput("www.kr-bim.co.uk")
setParameterByName = Element.SetParameterByName(element=all_elements_of_type, parameterName=string, value=string_2)
