# Dynamo graph StructuralElementReferenceLevels.dyn (Dynamo 2.0.2.6826)

categories = Categories(index=506)
all_elements_of_category = ElementsOfCategory(Category=categories)
parameters = Element.Parameters(element=all_elements_of_category)
categories_2 = Categories(index=535)
all_elements_of_category_2 = ElementsOfCategory(Category=categories_2)
string = StringInput("Reference Level")
parameterByName = Parameter.ParameterByName(element=all_elements_of_category_2, name=string)
watch = Watch(parameterByName)
string_from_object = FromObject(obj=watch)
string_2 = StringInput(" :")
split = String.Split(str=string_from_object, separater0=string_2)
flatten = List.Flatten(list=split)
code_block = CodeBlock { 2; }
takeEveryNthItem = List.TakeEveryNthItem(list=flatten, n=code_block)
uniqueItems = List.UniqueItems(list=takeEveryNthItem)
string_3 = StringInput("Base Level")
parameterByName_2 = Parameter.ParameterByName(element=all_elements_of_category, name=string_3)
string_from_object_2 = FromObject(obj=parameterByName_2)
string_4 = StringInput(" :")
split_2 = String.Split(str=string_from_object_2, separater0=string_4)
flatten_2 = List.Flatten(list=split_2)
code_block_2 = CodeBlock { 2; }
takeEveryNthItem_2 = List.TakeEveryNthItem(list=flatten_2, n=code_block_2)
uniqueItems_2 = List.UniqueItems(list=takeEveryNthItem_2)
list_create = List.Create(item0=takeEveryNthItem_2, item1=takeEveryNthItem)
flatten_3 = List.Flatten(list=list_create)
uniqueItems_3 = List.UniqueItems(list=flatten_3)
sort = List.Sort(list=uniqueItems_3)
count = List.Count(list=sort)
code_block_3 = CodeBlock { -1; }
sub = count - code_block_3
list_create_2 = List.Create(item0=all_elements_of_category, item1=all_elements_of_category_2)
flatten_4 = List.Flatten(list=list_create_2)
integer_slider = IntegerSlider(255, range=0..255 step 1)
byARGB = Color.ByARGB(r=integer_slider)
byARGB_2 = Color.ByARGB(g=integer_slider)
byARGB_3 = Color.ByARGB(b=integer_slider)
list_create_3 = List.Create(item0=byARGB, item1=byARGB_2, item2=byARGB_3)
indexOf = List.IndexOf(list=sort, element=flatten_3)
code_block_4 = CodeBlock { 0; }
code_block_5 = CodeBlock { 1; }
remapRange = Math.RemapRange(numbers=indexOf, newMin=code_block_4, newMax=code_block_5)
color_range = ColorRange(colors=list_create_3, value=remapRange)  # unwired: indices
overrideColorInView = Element.OverrideColorInView(element=flatten_4, color=color_range)
uniqueItems_4 = List.UniqueItems(list=remapRange)
sortIndexByValue = List.SortIndexByValue(list=uniqueItems_4)
