# Dynamo graph WhoDidWhat.dyn (Dynamo 2.0.2.6826)

collect_all_elements_in_model = Custom[Collect All Elements in Model]()
getWorksharingTooltipInfo = archilab.Revit.Elements.Elements.GetWorksharingTooltipInfo(element=collect_all_elements_in_model.elements)
watch = Watch(getWorksharingTooltipInfo.Creator)
uniqueItems = List.UniqueItems(list=watch)
code_block = CodeBlock { 3; }
getItemAtIndex = List.GetItemAtIndex(list=uniqueItems, index=code_block)
string_from_object = FromObject(obj=getItemAtIndex)
indexOf = List.IndexOf(list=watch, element=string_from_object)
id = Element.Id(element=collect_all_elements_in_model.elements)
allIndicesOf = List.AllIndicesOf(list=watch, item=string_from_object)
getItemAtIndex_2 = List.GetItemAtIndex(list=id, index=allIndicesOf)
byElementId = archilab.Revit.Selection.Select.ByElementId(id=getItemAtIndex_2)
views = Views(index=4)
isVisible = archilab.Revit.Elements.Elements.IsVisible(element=byElementId, view=views)
filterByBoolMask = List.FilterByBoolMask(list=byElementId, mask=isVisible)
isolate_in_view = Custom[Isolate in View](Element=filterByBoolMask.in, View=views)  # This node will take input of elements and a view to isolate selected elements in a view.
count = List.Count(list=filterByBoolMask.in)
